# Grasshopper definition layoutTesting.gh (Grasshopper 1.0.7)
# plug-ins: GenerativeBuilding

leg_1 = Slider(0.2, range=0..1)
leg2 = Slider(0.5, range=0..1)
leg3 = Slider(0.9, range=0..1)
numstories = Slider(3, range=1..5)
storyheight = Slider(10, range=0..10)
corridorwidth = Slider(6, range=0..100)
unitdepth = Slider(27, range=0..100)
multiplication = Multiplication(A=unitdepth, B=2)
main = Slider(1, range=0..1)
multiplication_2 = Multiplication(A=Slider(120, range=0..120), B=3)
multiplication_3 = Multiplication(A=Slider(120, range=0..120), B=3)
c_script = CSharpScript(x=leg_1)  # -> out, A; inputs x: Double
# ---------- c_script: C# ----------
    if(x < 0.3){
      A = 0;
    }
    else
    {
      A = x; 
    }
# ---------- end c_script ----------
c_script_2 = CSharpScript(x=leg2)  # -> out, A; inputs x: Double; same code as c_script
c_script_3 = CSharpScript(x=leg3)  # -> out, A; inputs x: Double; same code as c_script
addition = Addition(A=multiplication, B=corridorwidth)
multiplication_4 = Multiplication(A=numstories, B=storyheight)
rectangle = Rectangle(Plane=PlaneXY(0, 0, 0), XSize=multiplication_2, YSize=multiplication_3, Radius=0)  # -> Rectangle, Length
crv = Curve(rectangle.Rectangle)
cp = ControlPoints(Curve=crv)  # -> Points, Weights, Knots
item = ListItem(List=cp.Points, Index=0, Wrap=True)

multiplication_5 = Multiplication(A=unitdepth, B=2)
subtraction = Subtraction(A=multiplication_2, B=multiplication_5)
multiplication_6 = Multiplication(A=subtraction, B=main)
vec = VectorXYZ(XComponent=unitdepth, YComponent=unitdepth, ZComponent=0)  # -> Vector, Length
X = UnitX(Factor=multiplication_6)
move = Move(Geometry=item, Motion=vec.Vector)  # -> Geometry, Transform
move_2 = Move(Geometry=move.Geometry, Motion=X)  # -> Geometry, Transform
ln = Line(StartPoint=move.Geometry, EndPoint=move_2.Geometry)

ext = ExtendCurve(Curve=ln, Type=0, Start=unitdepth, End=unitdepth)
division = Division(A=corridorwidth, B=2)
neg = Negative(Value=division)
len = Length(Curve=ln)
c_script_4 = CSharpScript(height=multiplication_4, width=addition, primaryLength=len, legTwoRatio=c_script_2.A, legThreeRatio=c_script_3.A)  # -> legTwo, legThree; inputs height: Double, width: Double, primaryLength: Double
# ---------- c_script_4: C# ----------
    if((primaryLength - width) > height)
    {
      legThree = legThreeRatio;
    }
    else
    {
      legThree = 0;
    }

    if(primaryLength - 2 * width > height)
    {
      legTwo = legTwoRatio;
    }
    else
    {
      legTwo = 0;
    }
# ---------- end c_script_4 ----------
merge = Merge(Data1=division, Data2=neg)
path = FilePath("C:\dev\dbei-hackathon-na-2019\extern\unitMix.csv")
path_2 = FilePath("C:\dev\dbei-hackathon-na-2019\extern\units.csv")
col = Colour(RGB(122, 118, 255))
panel = Panel(col)

subtraction_2 = Subtraction(A=multiplication_3, B=multiplication_5)
multiplication_7 = Multiplication(A=subtraction_2, B=c_script.A)

multiplication_8 = Multiplication(A=subtraction_2, B=c_script_4.legThree)
Y = UnitY(Factor=multiplication_8)
len_2 = Length(Curve=ln)
X_2 = UnitX(Factor=len_2)
move_3 = Move(Geometry=move.Geometry, Motion=Y)  # -> Geometry, Transform
move_4 = Move(Geometry=move_3.Geometry, Motion=X_2)  # -> Geometry, Transform
move_5 = Move(Geometry=move.Geometry, Motion=X_2)  # -> Geometry, Transform
ln_2 = Line(StartPoint=move_5.Geometry, EndPoint=move_4.Geometry)

division_2 = Division(A=multiplication_7, B=3)
division_3 = Division(A=multiplication_8, B=3)
int = Integer(division_2)
int_2 = Integer(division_3)
multiplication_9 = Multiplication(A=int, B=3)
multiplication_10 = Multiplication(A=int_2, B=3)

Y_2 = UnitY(Factor=multiplication_9)
move_6 = Move(Geometry=move.Geometry, Motion=Y_2)  # -> Geometry, Transform
ln_3 = Line(StartPoint=move.Geometry, EndPoint=move_6.Geometry)

multiplication_11 = Multiplication(A=subtraction_2, B=c_script_4.legTwo)
len_3 = Length(Curve=ln)
division_4 = Division(A=len_3, B=2)
X_3 = UnitX(Factor=division_4)
move_7 = Move(Geometry=move.Geometry, Motion=X_3)  # -> Geometry, Transform

division_5 = Division(A=multiplication_11, B=3)
int_3 = Integer(division_5)
multiplication_12 = Multiplication(A=int_3, B=3)

Y_3 = UnitY(Factor=multiplication_12)
move_8 = Move(Geometry=move.Geometry, Motion=Y_3)  # -> Geometry, Transform
move_9 = Move(Geometry=move_8.Geometry, Motion=X_3)  # -> Geometry, Transform
ln_4 = Line(StartPoint=move_7.Geometry, EndPoint=move_9.Geometry)

merge_2 = Merge(Data1=ln, Data2=ln_3, Data3=ln_4, Data4=ln_2)
c_script_5 = CSharpScript(x=merge_2)  # -> A; inputs x: Line
# ---------- c_script_5: C# ----------
    if(x.Length!=0)
    {
      A = x;
    }
# ---------- end c_script_5 ----------
clean = CleanTree(RemoveNulls=True, RemoveInvalid=True, RemoveEmpty=False, Tree=c_script_5)
offset = OffsetCurve(Curve=clean, Distance=simplify(graft(merge)), Plane=PlaneXY(0, 0, 0), Corners=1)  # -> simplify(Curve)
generativebuilding = GenerativeBuilding(
    UnitDefCSV=path_2,
    UnitMixCSV=path,
    MainCorridor=ext,
    LeftCorridor=ln_3,
    MiddleCorridor=ln_4,
    RightCorridor=ln_2,
    UnitDepth=unitdepth,
    HallWidth=corridorwidth)  # -> Units, CorridorLines, UnitNames, ShearWallLines
line = Line(generativebuilding.CorridorLines)
line_2 = Line(generativebuilding.ShearWallLines)
c_script_6 = CSharpScript(x=generativebuilding.UnitNames)  # -> A; inputs x: String
# ---------- c_script_6: C# ----------
    if(x == "S")
    {
      A = "0,100,200";
    }
    if(x == "A")
    {
      A = "200,0,100";
    }
    if(x == "B")
    {
      A = "100,200,0";
    }
    if(x == "C")
    {
      A = "200,100,0";
    }
# ---------- end c_script_6 ----------
pipe = Pipe(Curve=line_2, Radius=1, Caps=0)
srf = Surface(generativebuilding.Units)
preview = CustomPreview(Geometry=pipe, Material=ColourSwatch(SwatchColor=RGB(255, 0, 0)))
preview_2 = CustomPreview(Geometry=srf, Material=c_script_6)
